# Grasshopper definition Brandthaus_Robot_with_positioner.gh (Grasshopper 1.0.7)
# plug-ins: RobotComponentsABB, RobotComponentsEDEK

# ----
# Replace by three calibraction points.
# Use e.g. the controller utility components.
# Update the position in the controller configuration.
# The position in the controller, this Grasshopper file
# and the physical axis should match
pt = Point(Point(2000, -2000, 1080))
pt_2 = Point(Point(2000, -2000, 1537.886995))
pt_3 = Point(Point(2448.79765, -2000, 1080))
pl_3pt = Plane3Pt(PointA=pt, PointB=pt_2, PointC=pt_3)

# ----
# EDEK rule:
# The x-axis of the axis plane
# is always aligned with the z-axis
# of the world coordinate space
Z = UnitZ(Factor=1)
align = AlignPlane(Plane=pl_3pt, Direction=Z)  # -> Plane, Angle

# ----
# Values for controller configuration
ptoq = PlaneToQuaternion(Plane=pl_3pt, ReferencePlane=PlaneXY(0, 0, 0))  # -> CoordX, CoordY, CoordZ, QuaternionA, QuaternionB, QuaternionC, QuaternionD, String
panel = Panel(ptoq.CoordX)
panel_2 = Panel(ptoq.CoordZ)
panel_3 = Panel(ptoq.QuaternionA)
panel_4 = Panel(ptoq.QuaternionB)
panel_5 = Panel(ptoq.QuaternionC)
panel_6 = Panel(ptoq.QuaternionD)
panel_7 = Panel(ptoq.CoordY)

# ----
# The preset: Positioner + Robot
irbp_l300_l4000 = IRBPL300L4000(AxisPlane=align.Plane)
irb4600 = IRB460040255Platform(ExternalAxis=irbp_l300_l4000)

# ----
# Code and path generation playground
pt_4 = Point(Point(2225.309735, 971.834103, 710.6332853))
xy = XYPlane(Origin=pt_4)
flip_plane_x = FlipPlaneX(Plane=xy)
T = ActionTarget(
    Name="rob_target",
    Plane=flip_plane_x,
    AxisConfiguration=Slider(0, range=0..7),
    ExternalAxisValueA=Slider(108, range=-360..360),
    Override_External_Axis_Values=True,
    Set_Reference_Plane=False)
list = ValueList({"MoveAbsJ": 0, "MoveL": 1, "MoveJ": 2}, selected="MoveJ")
ajm = ActionAbsoluteJointMovement(
    Name="joint_target",
    InternalAxisValues=[0, 0, 0, 0, 0, 0],
    ExternalAxisValues=Slider(0, range=-360..360),
    SpeedData=Slider(200, range=0..1000),
    Override_Robot_Tool=False)
M = ActionMovement(
    Target=T,
    SpeedData=Slider(200, range=0..1000),
    MovementType=list,
    Override_Robot_Tool=False,
    Override_Work_Object=False,
    Set_Digital_Output=False)
merge = Merge(Data1=flatten(ajm), Data2=flatten(M), Data3=flatten(ajm))
rg = RAPIDGenerator(RobotInfo=irb4600, Action=merge, ProgramName="MainModule", SystemName="BASE", Update=True)  # -> ProgramModule, SystemModule
pg = PathGenerator(
    RobotInfo=irb4600,
    Action=merge,
    Interpolations=5,
    AnimationSlider=Slider(1, range=0..1),
    Update=True,
    Set_Preview_Curve=True,
    Set_Preview_Mesh=False)  # -> Plane, ExternalAxisPlanes, InternalAxisValues, ExternalAxisValues, ToolPath
panel_8 = Panel(rg.ProgramModule)
panel_9 = Panel(rg.SystemModule)

# ----
# Controller utility playground
button = Button()
gc = GetController(Update=button)
list_2 = ValueList({"World": 1, "Base": 2, "Work Object": 4}, selected="World")
timer = Timer(TimerInterval=20, Target=[gp, ga])  # disabled
ga = GetAxisValues(RobotController=gc)  # -> InternalAxisValues, ExternalAxisValues
gp = GetPlane(RobotController=gc, CoordinateSystem=list_2)  # -> Plane, Name
remote_connection = RemoteConnection(
    RobotController=gc,
    Connect=Toggle(True),
    Upload=Button(),
    Run=Button(),
    Stop=Button(),
    ProgramModule=rg.ProgramModule,
    SystemModule=rg.SystemModule)
pv = PlaneVisualizer(Plane=gp.Plane)
panel_10 = Panel(remote_connection)
fk = ForwardKinematics(
    RobotInfo=irb4600,
    InternalAxisValues=ga.InternalAxisValues,
    ExternalAxisValues=ga.ExternalAxisValues,
    Set_Hide_Mesh=False)  # -> PosedMeshes, EndPlane, ExternalAxisPlanes
pv_2 = PlaneVisualizer(Plane=fk.EndPlane)

# ----
# Forward kinematics playground
number_slider = Slider(35, range=-360..360)
merge_2 = Merge(
    Data1=number_slider,
    Data2=Slider(75, range=-360..360),
    Data3=Slider(-137, range=-360..360),
    Data4=Slider(27, range=-360..360),
    Data5=Slider(22, range=-360..360),
    Data6=Slider(102, range=-360..360))
fk_2 = ForwardKinematics(RobotInfo=irb4600, InternalAxisValues=merge_2, ExternalAxisValues=Slider(102, range=-360..360), Set_Hide_Mesh=False)  # -> PosedMeshes, EndPlane, ExternalAxisPlanes
