# Grasshopper definition Brandthaus_Robot_with_track.gh (Grasshopper 1.0.7)
# plug-ins: RobotComponentsABB, RobotComponentsEDEK

# ----
# This is not the final position.
# This has to be configured and decided later.
number_slider = Slider(4940, range=-10000..10000)  # disabled
number_slider_2 = Slider(2614, range=-10000..10000)  # disabled
number_slider_3 = Slider(-1528, range=-10000..10000)  # disabled
pt = ConstructPoint(XCoordinate=number_slider_3, YCoordinate=number_slider, ZCoordinate=number_slider_2)  # disabled
xy = XYPlane(Origin=pt)  # disabled
flip_plane_y = FlipPlaneY(Plane=xy)  # disabled
panel = Panel("-1")  # disabled
Y = UnitY(Factor=panel)  # disabled
align = AlignPlane(Plane=flip_plane_y, Direction=Y)  # -> Plane, Angle; disabled

# ----
# The preset: Track + Robot
gudel = GUDELTrack()
irb4600 = IRB460040255(PositionPlane=PlaneXY(0, 0, 0), ExternalAxis=gudel)

# ----
# Code and path generation playground
pt_2 = Point(Point(0, 0, 521.1986835))
xy_2 = XYPlane(Origin=pt_2)
flip_plane_x = FlipPlaneX(Plane=xy_2)
T = ActionTarget(
    Name="rob_target",
    Plane=flip_plane_x,
    AxisConfiguration=Slider(0, range=0..7),
    Override_External_Axis_Values=False,
    Set_Reference_Plane=False)
list = ValueList({"MoveAbsJ": 0, "MoveL": 1, "MoveJ": 2}, selected="MoveAbsJ")
ajm = ActionAbsoluteJointMovement(
    Name="joint_target",
    InternalAxisValues=[0, 0, 0, 0, 0, 0],
    ExternalAxisValues=Slider(0, range=0..100),
    SpeedData=Slider(200, range=0..1000),
    Override_Robot_Tool=False)
M = ActionMovement(
    Target=T,
    SpeedData=Slider(200, range=0..1000),
    MovementType=list,
    Override_Robot_Tool=False,
    Override_Work_Object=False,
    Set_Digital_Output=False)
merge = Merge(Data1=flatten(ajm), Data2=flatten(M), Data3=flatten(ajm))
pg = PathGenerator(
    RobotInfo=irb4600,
    Action=merge,
    Interpolations=5,
    AnimationSlider=Slider(1, range=0..1),
    Update=True,
    Set_Preview_Curve=True,
    Set_Preview_Mesh=False)  # -> Plane, ExternalAxisPlanes, InternalAxisValues, ExternalAxisValues, ToolPath
rg = RAPIDGenerator(RobotInfo=irb4600, Action=merge, ProgramName="MainModule", SystemName="BASE", Update=True)  # -> ProgramModule, SystemModule
panel_2 = Panel(rg.ProgramModule)
panel_3 = Panel(rg.SystemModule)

# ----
# Controller utility playground
button = Button()
gc = GetController(Update=button)
list_2 = ValueList({"World": 1, "Base": 2, "Work Object": 4}, selected="World")
timer = Timer(TimerInterval=20, Target=[gp, ga])  # disabled
ga = GetAxisValues(RobotController=gc)  # -> InternalAxisValues, ExternalAxisValues
gp = GetPlane(RobotController=gc, CoordinateSystem=list_2)  # -> Plane, Name
remote_connection = RemoteConnection(
    RobotController=gc,
    Connect=Toggle(True),
    Upload=Button(),
    Run=Button(),
    Stop=Button(),
    ProgramModule=rg.ProgramModule,
    SystemModule=rg.SystemModule)
pv = PlaneVisualizer(Plane=gp.Plane)
panel_4 = Panel(remote_connection)
fk = ForwardKinematics(
    RobotInfo=irb4600,
    InternalAxisValues=ga.InternalAxisValues,
    ExternalAxisValues=ga.ExternalAxisValues,
    Set_Hide_Mesh=False)  # -> PosedMeshes, EndPlane, ExternalAxisPlanes
pv_2 = PlaneVisualizer(Plane=fk.EndPlane)

# ----
# Forward kinematics playground
number_slider_4 = Slider(35, range=-360..360)
merge_2 = Merge(
    Data1=number_slider_4,
    Data2=Slider(75, range=-360..360),
    Data3=Slider(-137, range=-360..360),
    Data4=Slider(27, range=-360..360),
    Data5=Slider(22, range=-360..360),
    Data6=Slider(102, range=-360..360))
fk_2 = ForwardKinematics(RobotInfo=irb4600, InternalAxisValues=merge_2, ExternalAxisValues=Slider(3778, range=-5..9620), Set_Hide_Mesh=False)  # -> PosedMeshes, EndPlane, ExternalAxisPlanes
