# Grasshopper definition Brandthaus_Robot_with_track_and_positioner.gh (Grasshopper 1.0.7)
# plug-ins: RobotComponentsABB, RobotComponentsEDEK

# ----
# This is not the final position.
# This has to be configured and decided later.
number_slider = Slider(4940, range=-10000..10000)  # disabled
number_slider_2 = Slider(2614, range=-10000..10000)  # disabled
number_slider_3 = Slider(-1528, range=-10000..10000)  # disabled
pt = ConstructPoint(XCoordinate=number_slider_3, YCoordinate=number_slider, ZCoordinate=number_slider_2)  # disabled
xy = XYPlane(Origin=pt)  # disabled
flip_plane_y = FlipPlaneY(Plane=xy)  # disabled
panel = Panel("-1")  # disabled
Y = UnitY(Factor=panel)  # disabled
align = AlignPlane(Plane=flip_plane_y, Direction=Y)  # -> Plane, Angle; disabled

# ----
# Replace by three calibraction points.
# Use e.g. the controller utility components.
# Update the position in the controller configuration.
# The position in the controller, this Grasshopper file
# and the physical axis should match
pt_2 = Point(Point(542, 2011, 1080))
pt_3 = Point(Point(542, 2011, 1412.057252))
pt_4 = Point(Point(170.4743308, 2011, 1080))
pl_3pt = Plane3Pt(PointA=pt_2, PointB=pt_3, PointC=pt_4)

# ----
# EDEK rule:
# The x-axis of the axis plane
# is always aligned with the z-axis
# of the world coordinate space
Z = UnitZ(Factor=1)
align_2 = AlignPlane(Plane=pl_3pt, Direction=Z)  # -> Plane, Angle

# ----
# The preset: Track +  Positioner + Robot
gudel = GUDELTrack()
irbp_l300_l4000 = IRBPL300L4000(AxisPlane=align_2.Plane)
merge = Merge(Data1=gudel, Data2=irbp_l300_l4000)
irb4600 = IRB460040255(PositionPlane=PlaneXY(0, 0, 0), ExternalAxis=merge)

# ----
# Values for controller configuration
ptoq = PlaneToQuaternion(Plane=align_2.Plane, ReferencePlane=PlaneXY(0, 0, 0))  # -> CoordX, CoordY, CoordZ, QuaternionA, QuaternionB, QuaternionC, QuaternionD, String
panel_2 = Panel(ptoq.CoordX)
panel_3 = Panel(ptoq.CoordZ)
panel_4 = Panel(ptoq.CoordY)
panel_5 = Panel(ptoq.QuaternionA)
panel_6 = Panel(ptoq.QuaternionB)
panel_7 = Panel(ptoq.QuaternionC)
panel_8 = Panel(ptoq.QuaternionD)

# ----
# Code and path generation playground
pt_5 = Point(Point(0, 0, 521.1986835))
xy_2 = XYPlane(Origin=pt_5)
flip_plane_x = FlipPlaneX(Plane=xy_2)
T = ActionTarget(
    Name="rob_target",
    Plane=flip_plane_x,
    AxisConfiguration=Slider(0, range=0..7),
    ExternalAxisValueA=Slider(4311, range=0..9660),
    ExternalAxisValueB=Slider(100, range=0..100),
    Override_External_Axis_Values=True,
    Set_Reference_Plane=False)
merge_2 = Merge(Data1=Slider(0, range=0..9660), Data2=Slider(0, range=0..100))
list = ValueList({"MoveAbsJ": 0, "MoveL": 1, "MoveJ": 2}, selected="MoveJ")
ajm = ActionAbsoluteJointMovement(
    Name="joint_target",
    InternalAxisValues=[0, 0, 0, 0, 0, 0],
    ExternalAxisValues=merge_2,
    SpeedData=Slider(200, range=0..1000),
    Override_Robot_Tool=False)
M = ActionMovement(
    Target=T,
    SpeedData=Slider(200, range=0..1000),
    MovementType=list,
    Override_Robot_Tool=False,
    Override_Work_Object=False,
    Set_Digital_Output=False)
merge_3 = Merge(Data1=flatten(ajm), Data2=flatten(M), Data3=flatten(ajm))
pg = PathGenerator(
    RobotInfo=irb4600,
    Action=merge_3,
    Interpolations=5,
    AnimationSlider=Slider(0, range=0..1),
    Update=True,
    Set_Preview_Curve=True,
    Set_Preview_Mesh=False)  # -> Plane, ExternalAxisPlanes, InternalAxisValues, ExternalAxisValues, ToolPath
rg = RAPIDGenerator(RobotInfo=irb4600, Action=merge_3, ProgramName="MainModule", SystemName="BASE", Update=True)  # -> ProgramModule, SystemModule
panel_9 = Panel(rg.ProgramModule)
panel_10 = Panel(rg.SystemModule)

# ----
# Controller utility playground
button = Button()
gc = GetController(Update=button)
list_2 = ValueList({"World": 1, "Base": 2, "Work Object": 4}, selected="World")
timer = Timer(TimerInterval=20, Target=[gp, ga])  # disabled
ga = GetAxisValues(RobotController=gc)  # -> InternalAxisValues, flatten(ExternalAxisValues)
gp = GetPlane(RobotController=gc, CoordinateSystem=list_2)  # -> Plane, Name
remote_connection = RemoteConnection(
    RobotController=gc,
    Connect=Toggle(True),
    Upload=Button(),
    Run=Button(),
    Stop=Button(),
    ProgramModule=rg.ProgramModule,
    SystemModule=rg.SystemModule)
pv = PlaneVisualizer(Plane=gp.Plane)
panel_11 = Panel(remote_connection)
fk = ForwardKinematics(
    RobotInfo=irb4600,
    InternalAxisValues=ga.InternalAxisValues,
    ExternalAxisValues=ga.ExternalAxisValues,
    Set_Hide_Mesh=False)  # -> PosedMeshes, EndPlane, ExternalAxisPlanes
pv_2 = PlaneVisualizer(Plane=fk.EndPlane)

# ----
# Forward kinematics playground
number_slider_4 = Slider(-111, range=-360..360)
merge_4 = Merge(
    Data1=Slider(35, range=-360..360),
    Data2=Slider(75, range=-360..360),
    Data3=Slider(-137, range=-360..360),
    Data4=Slider(27, range=-360..360),
    Data5=Slider(22, range=-360..360),
    Data6=Slider(102, range=-360..360))
merge_5 = Merge(Data1=Slider(3779, range=-5..9620), Data2=number_slider_4)
fk_2 = ForwardKinematics(RobotInfo=irb4600, InternalAxisValues=merge_4, ExternalAxisValues=merge_5, Set_Hide_Mesh=False)  # -> PosedMeshes, EndPlane, ExternalAxisPlanes
