# Grasshopper definition Robotstudio_Robot_with_track.gh (Grasshopper 1.0.7)
# plug-ins: RobotComponentsABB, RobotComponentsEDEK

# ----
# Track + Robot
igus = IGUSTrack()
irb1200 = IRB1200509(PositionPlane=PlaneXY(0, 0, 0), ExternalAxis=igus)

merge = Merge(
    Data1=Slider(35, range=-360..360),
    Data2=Slider(44, range=-360..360),
    Data3=Slider(-9, range=-360..360),
    Data4=Slider(27, range=-360..360),
    Data5=Slider(22, range=-360..360),
    Data6=Slider(102, range=-360..360))
fk = ForwardKinematics(RobotInfo=irb1200, InternalAxisValues=merge, ExternalAxisValues=Slider(557, range=0..1150), Set_Hide_Mesh=False)  # -> PosedMeshes, EndPlane, ExternalAxisPlanes
