# Grasshopper definition ASL_Robot_with_track.gh (Grasshopper 1.0.7)
# plug-ins: RobotComponentsABB, RobotComponentsEDEK

# ----
# Track + Robot
igus = IGUSTrack()
irb1200 = IRB1200509(PositionPlane=PlaneXY(0, 0, 0), ExternalAxis=igus)

# ----
# Code and path generation playground
pt = Point(Point(295.658808, 564.7235156, 521.1986835))
xy = XYPlane(Origin=pt)
flip_plane_x = FlipPlaneX(Plane=xy)
T = ActionTarget(
    Name="rob_target",
    Plane=flip_plane_x,
    AxisConfiguration=Slider(0, range=0..7),
    Override_External_Axis_Values=False,
    Set_Reference_Plane=False)
list = ValueList({"MoveAbsJ": 0, "MoveL": 1, "MoveJ": 2}, selected="MoveAbsJ")
ajm = ActionAbsoluteJointMovement(
    Name="home_target",
    InternalAxisValues=[0, 0, 0, 0, 0, 0],
    ExternalAxisValues=Slider(0, range=0..100),
    SpeedData=Slider(200, range=0..1000),
    Override_Robot_Tool=False)
M = ActionMovement(
    Target=T,
    SpeedData=Slider(200, range=0..1000),
    MovementType=list,
    Override_Robot_Tool=False,
    Override_Work_Object=False,
    Set_Digital_Output=False)
merge = Merge(Data1=flatten(ajm), Data2=flatten(M), Data3=flatten(ajm))
pg = PathGenerator(
    RobotInfo=irb1200,
    Action=merge,
    Interpolations=5,
    AnimationSlider=Slider(0.5, range=0..1),
    Update=True,
    Set_Preview_Curve=True,
    Set_Preview_Mesh=True)  # -> Plane, ExternalAxisPlanes, InternalAxisValues, ExternalAxisValues, ToolPath
rg = RAPIDGenerator(RobotInfo=irb1200, Action=merge, ProgramName="MainModule", SystemName="BASE", Update=True)  # -> ProgramModule, SystemModule
panel = Panel(rg.ProgramModule)
panel_2 = Panel(rg.SystemModule)

# ----
# Forward kinematics playground
number_slider = Slider(35, range=-360..360)
merge_2 = Merge(
    Data1=number_slider,
    Data2=Slider(44, range=-360..360),
    Data3=Slider(-9, range=-360..360),
    Data4=Slider(27, range=-360..360),
    Data5=Slider(22, range=-360..360),
    Data6=Slider(102, range=-360..360))
fk = ForwardKinematics(RobotInfo=irb1200, InternalAxisValues=merge_2, ExternalAxisValues=Slider(557, range=0..1150), Set_Hide_Mesh=False)  # -> PosedMeshes, EndPlane, ExternalAxisPlanes

# ----
# Controller utility playground
button = Button()
gc = GetController(Update=button)
list_2 = ValueList({"World": 1, "Base": 2, "Work Object": 4}, selected="World")
timer = Timer(TimerInterval=20, Target=[gp, ga])  # disabled
ga = GetAxisValues(RobotController=gc)  # -> InternalAxisValues, ExternalAxisValues
gp = GetPlane(RobotController=gc, CoordinateSystem=list_2)  # -> Plane, Name
remote_connection = RemoteConnection(
    RobotController=gc,
    Connect=Toggle(True),
    Upload=Button(),
    Run=Button(),
    Stop=Button(),
    ProgramModule=rg.ProgramModule,
    SystemModule=rg.SystemModule)
pv = PlaneVisualizer(Plane=gp.Plane)
panel_3 = Panel(remote_connection)
fk_2 = ForwardKinematics(
    RobotInfo=irb1200,
    InternalAxisValues=ga.InternalAxisValues,
    ExternalAxisValues=ga.ExternalAxisValues,
    Set_Hide_Mesh=False)  # -> PosedMeshes, EndPlane, ExternalAxisPlanes
pv_2 = PlaneVisualizer(Plane=fk_2.EndPlane)
