# Grasshopper definition ASL_Robot_with_track_and_positioner.gh (Grasshopper 1.0.7)
# plug-ins: RobotComponentsABB, RobotComponentsEDEK

# ----
# Base Frame
panel = Panel("180.865841")
qtop = QuaternionToPlane(
    CoordX=panel,
    CoordY="1303.35484",
    CoordZ="348.908968",
    QuaternionA="0.495992",
    QuaternionB="0.503979",
    QuaternionC="-0.496175",
    QuaternionD="0.503793")

# ----
# Aditional link mesh
number_slider = Slider(1000, range=0..1000)
Z = UnitZ(Factor=1)
line = LineSDL(Start=Point(0, 0, 0), Direction=Z, Length=number_slider)
pipe = Pipe(Curve=line, Radius=Slider(25, range=0..100), Caps=0)

# ----
# Track + Positioner + Robot
igus_pos = IGUSPositioner(AxisPlane=qtop, LinkMesh=pipe)
igus = IGUSTrack()
merge = Merge(Data1=flatten(igus), Data2=flatten(igus_pos))
irb1200 = IRB1200509(PositionPlane=PlaneXY(0, 0, 0), ExternalAxis=merge)

# ----
# Forward kinematics playground
number_slider_2 = Slider(600, range=0..1150)
merge_2 = Merge(
    Data1=Slider(35, range=-360..360),
    Data2=Slider(44, range=-360..360),
    Data3=Slider(-9, range=-360..360),
    Data4=Slider(27, range=-360..360),
    Data5=Slider(22, range=-360..360),
    Data6=Slider(102, range=-360..360))
merge_3 = Merge(Data1=number_slider_2, Data2=Slider(-44, range=-360..360))
fk = ForwardKinematics(RobotInfo=irb1200, InternalAxisValues=merge_2, ExternalAxisValues=merge_3, Set_Hide_Mesh=False)  # -> PosedMeshes, EndPlane, ExternalAxisPlanes

# ----
# Code and path generation playground
pt = Point(Point(156.1363874, 783.4629187, 407.3261398))
xy = XYPlane(Origin=pt)
flip_plane_x = FlipPlaneX(Plane=xy)
T = ActionTarget(
    Name="rob_target",
    Plane=flip_plane_x,
    AxisConfiguration=Slider(0, range=0..7),
    ExternalAxisValueB=Slider(100, range=0..100),
    Override_External_Axis_Values=True,
    Set_Reference_Plane=False)
merge_4 = Merge(Data1=Slider(0, range=0..9660), Data2=Slider(0, range=0..100))
list = ValueList({"MoveAbsJ": 0, "MoveL": 1, "MoveJ": 2}, selected="MoveJ")
ajm = ActionAbsoluteJointMovement(
    Name="home_target",
    InternalAxisValues=[0, 0, 0, 0, 0, 0],
    ExternalAxisValues=merge_4,
    SpeedData=Slider(200, range=0..1000),
    Override_Robot_Tool=False)
M = ActionMovement(
    Target=T,
    SpeedData=Slider(200, range=0..1000),
    MovementType=list,
    Override_Robot_Tool=False,
    Override_Work_Object=False,
    Set_Digital_Output=False)
merge_5 = Merge(Data1=flatten(ajm), Data2=flatten(M), Data3=flatten(ajm))
pg = PathGenerator(
    RobotInfo=irb1200,
    Action=merge_5,
    Interpolations=5,
    AnimationSlider=Slider(0.282, range=0..1),
    Update=True,
    Set_Preview_Curve=True,
    Set_Preview_Mesh=True)  # -> Plane, ExternalAxisPlanes, InternalAxisValues, ExternalAxisValues, ToolPath
rg = RAPIDGenerator(RobotInfo=irb1200, Action=merge_5, ProgramName="MainModule", SystemName="BASE", Update=True)  # -> ProgramModule, SystemModule
panel_2 = Panel(rg.ProgramModule)
panel_3 = Panel(rg.SystemModule)

# ----
# Controller utility playground
button = Button()
gc = GetController(Update=button)
list_2 = ValueList({"World": 1, "Base": 2, "Work Object": 4}, selected="World")
timer = Timer(TimerInterval=20, Target=[gp, ga])  # disabled
ga = GetAxisValues(RobotController=gc)  # -> InternalAxisValues, flatten(ExternalAxisValues)
gp = GetPlane(RobotController=gc, CoordinateSystem=list_2)  # -> Plane, Name
remote_connection = RemoteConnection(
    RobotController=gc,
    Connect=Toggle(True),
    Upload=Button(),
    Run=Button(),
    Stop=Button(),
    ProgramModule=rg.ProgramModule,
    SystemModule=rg.SystemModule)
pv = PlaneVisualizer(Plane=gp.Plane)
panel_4 = Panel(remote_connection)
fk_2 = ForwardKinematics(
    RobotInfo=irb1200,
    InternalAxisValues=ga.InternalAxisValues,
    ExternalAxisValues=ga.ExternalAxisValues,
    Set_Hide_Mesh=False)  # -> PosedMeshes, EndPlane, ExternalAxisPlanes
pv_2 = PlaneVisualizer(Plane=fk_2.EndPlane)
