# Grasshopper definition Brandthaus_Robot_with_positioner.gh (Grasshopper 1.0.7)
# plug-ins: RobotComponentsABB, RobotComponentsEDEK

# ----
# Base Frame
panel = Panel("1609.828051")
qtop = QuaternionToPlane(
    CoordX=panel,
    CoordY="-2199.237275",
    CoordZ="855.82839",
    QuaternionA="-0.497072",
    QuaternionB="0.500446",
    QuaternionC="0.501025",
    QuaternionD="0.501445")

# ----
# Aditional link mesh
number_slider = Slider(4000, range=0..4000)
Z = UnitZ(Factor=1)
line = LineSDL(Start=Point(0, 0, 0), Direction=Z, Length=number_slider)
pipe = Pipe(Curve=line, Radius=Slider(25, range=0..100), Caps=0)

# ----
# The preset: Positioner + Robot
irbp_l300_l4000 = IRBPL300L4000(AxisPlane=qtop, LinkMesh=pipe)
irb4600 = IRB460040255Platform(ExternalAxis=irbp_l300_l4000)

# ----
# Code and path generation playground
pt = Point(Point(1476.82457, 1197.866006, 935.8008336))
xy = XYPlane(Origin=pt)
flip_plane_x = FlipPlaneX(Plane=xy)
T = ActionTarget(
    Name="rob_target",
    Plane=flip_plane_x,
    AxisConfiguration=Slider(0, range=0..7),
    ExternalAxisValueA=Slider(108, range=-360..360),
    Override_External_Axis_Values=True,
    Set_Reference_Plane=False)
list = ValueList({"MoveAbsJ": 0, "MoveL": 1, "MoveJ": 2}, selected="MoveJ")
ajm = ActionAbsoluteJointMovement(
    Name="home_target",
    InternalAxisValues=[0, 0, 0, 0, 0, 0],
    ExternalAxisValues=Slider(0, range=-360..360),
    SpeedData=Slider(200, range=0..1000),
    Override_Robot_Tool=False)
M = ActionMovement(
    Target=T,
    SpeedData=Slider(200, range=0..1000),
    MovementType=list,
    Override_Robot_Tool=False,
    Override_Work_Object=False,
    Set_Digital_Output=False)
merge = Merge(Data1=flatten(ajm), Data2=flatten(M), Data3=flatten(ajm))
rg = RAPIDGenerator(RobotInfo=irb4600, Action=merge, ProgramName="MainModule", SystemName="BASE", Update=True)  # -> ProgramModule, SystemModule
pg = PathGenerator(
    RobotInfo=irb4600,
    Action=merge,
    Interpolations=5,
    AnimationSlider=Slider(0, range=0..1),
    Update=True,
    Set_Preview_Curve=True,
    Set_Preview_Mesh=True)  # -> Plane, ExternalAxisPlanes, InternalAxisValues, ExternalAxisValues, ToolPath
panel_2 = Panel(rg.ProgramModule)
panel_3 = Panel(rg.SystemModule)

# ----
# Forward kinematics playground
number_slider_2 = Slider(35, range=-360..360)
merge_2 = Merge(
    Data1=number_slider_2,
    Data2=Slider(75, range=-360..360),
    Data3=Slider(-137, range=-360..360),
    Data4=Slider(27, range=-360..360),
    Data5=Slider(22, range=-360..360),
    Data6=Slider(102, range=-360..360))
fk = ForwardKinematics(RobotInfo=irb4600, InternalAxisValues=merge_2, ExternalAxisValues=Slider(102, range=-360..360), Set_Hide_Mesh=False)  # -> PosedMeshes, EndPlane, ExternalAxisPlanes

# ----
# Controller utility playground
button = Button()
gc = GetController(Update=button)
list_2 = ValueList({"World": 1, "Base": 2, "Work Object": 4}, selected="World")
timer = Timer(TimerInterval=20, Target=[gp, ga])  # disabled
ga = GetAxisValues(RobotController=gc)  # -> InternalAxisValues, ExternalAxisValues
gp = GetPlane(RobotController=gc, CoordinateSystem=list_2)  # -> Plane, Name
remote_connection = RemoteConnection(
    RobotController=gc,
    Connect=Toggle(True),
    Upload=Button(),
    Run=Button(),
    Stop=Button(),
    ProgramModule=rg.ProgramModule,
    SystemModule=rg.SystemModule)
pv = PlaneVisualizer(Plane=gp.Plane)
panel_4 = Panel(remote_connection)
fk_2 = ForwardKinematics(
    RobotInfo=irb4600,
    InternalAxisValues=ga.InternalAxisValues,
    ExternalAxisValues=ga.ExternalAxisValues,
    Set_Hide_Mesh=False)  # -> PosedMeshes, EndPlane, ExternalAxisPlanes
pv_2 = PlaneVisualizer(Plane=fk_2.EndPlane)
