# Grasshopper definition Brandthaus_Robot_with_track_and_positioner.gh (Grasshopper 1.0.7)
# plug-ins: RobotComponentsABB, RobotComponentsEDEK

# ----
# Base Frame
panel = Panel("-1800")
qtop = QuaternionToPlane(
    CoordX=panel,
    CoordY="2000",
    CoordZ="855",
    QuaternionA="-0.50",
    QuaternionB="0.50",
    QuaternionC="0.50",
    QuaternionD="0.50")

# ----
# Aditional link mesh
number_slider = Slider(4000, range=0..4000)
Z = UnitZ(Factor=1)
line = LineSDL(Start=Point(0, 0, 0), Direction=Z, Length=number_slider)
pipe = Pipe(Curve=line, Radius=Slider(25, range=0..100), Caps=0)

# ----
# The preset: Track +  Positioner + Robot
irbp_l300_l4000 = IRBPL300L4000(AxisPlane=qtop, LinkMesh=pipe)
gudel = GUDELTrack()
merge = Merge(Data1=flatten(gudel), Data2=flatten(irbp_l300_l4000))
irb4600 = IRB460040255(PositionPlane=PlaneXY(0, 0, 0), ExternalAxis=merge)

# ----
# Code and path generation playground
pt = Point(Point(-1124.674129, 4088.607358, 521.1986835))
xy = XYPlane(Origin=pt)
flip_plane_x = FlipPlaneX(Plane=xy)
T = ActionTarget(
    Name="rob_target",
    Plane=flip_plane_x,
    AxisConfiguration=Slider(0, range=0..7),
    ExternalAxisValueB=Slider(100, range=0..100),
    Override_External_Axis_Values=True,
    Set_Reference_Plane=False)
merge_2 = Merge(Data1=Slider(0, range=0..9660), Data2=Slider(0, range=0..100))
list = ValueList({"MoveAbsJ": 0, "MoveL": 1, "MoveJ": 2}, selected="MoveJ")
ajm = ActionAbsoluteJointMovement(
    Name="home_target",
    InternalAxisValues=[0, 0, 0, 0, 0, 0],
    ExternalAxisValues=merge_2,
    SpeedData=Slider(200, range=0..1000),
    Override_Robot_Tool=False)
M = ActionMovement(
    Target=T,
    SpeedData=Slider(200, range=0..1000),
    MovementType=list,
    Override_Robot_Tool=False,
    Override_Work_Object=False,
    Set_Digital_Output=False)
merge_3 = Merge(Data1=flatten(ajm), Data2=flatten(M), Data3=flatten(ajm))
pg = PathGenerator(
    RobotInfo=irb4600,
    Action=merge_3,
    Interpolations=5,
    AnimationSlider=Slider(0, range=0..1),
    Update=True,
    Set_Preview_Curve=True,
    Set_Preview_Mesh=True)  # -> Plane, ExternalAxisPlanes, InternalAxisValues, ExternalAxisValues, ToolPath
rg = RAPIDGenerator(RobotInfo=irb4600, Action=merge_3, ProgramName="MainModule", SystemName="BASE", Update=True)  # -> ProgramModule, SystemModule
panel_2 = Panel(rg.ProgramModule)
panel_3 = Panel(rg.SystemModule)

# ----
# Forward kinematics playground
number_slider_2 = Slider(-111, range=-360..360)
merge_4 = Merge(
    Data1=Slider(35, range=-360..360),
    Data2=Slider(75, range=-360..360),
    Data3=Slider(-137, range=-360..360),
    Data4=Slider(27, range=-360..360),
    Data5=Slider(22, range=-360..360),
    Data6=Slider(102, range=-360..360))
merge_5 = Merge(Data1=Slider(3779, range=-5..9620), Data2=number_slider_2)
fk = ForwardKinematics(RobotInfo=irb4600, InternalAxisValues=merge_4, ExternalAxisValues=merge_5, Set_Hide_Mesh=False)  # -> PosedMeshes, EndPlane, ExternalAxisPlanes

# ----
# Controller utility playground
button = Button()
gc = GetController(Update=button)
list_2 = ValueList({"World": 1, "Base": 2, "Work Object": 4}, selected="World")
timer = Timer(TimerInterval=20, Target=[gp, ga])  # disabled
ga = GetAxisValues(RobotController=gc)  # -> InternalAxisValues, flatten(ExternalAxisValues)
gp = GetPlane(RobotController=gc, CoordinateSystem=list_2)  # -> Plane, Name
remote_connection = RemoteConnection(
    RobotController=gc,
    Connect=Toggle(True),
    Upload=Button(),
    Run=Button(),
    Stop=Button(),
    ProgramModule=rg.ProgramModule,
    SystemModule=rg.SystemModule)
pv = PlaneVisualizer(Plane=gp.Plane)
panel_4 = Panel(remote_connection)
fk_2 = ForwardKinematics(
    RobotInfo=irb4600,
    InternalAxisValues=ga.InternalAxisValues,
    ExternalAxisValues=ga.ExternalAxisValues,
    Set_Hide_Mesh=False)  # -> PosedMeshes, EndPlane, ExternalAxisPlanes
pv_2 = PlaneVisualizer(Plane=fk_2.EndPlane)
