# Grasshopper definition Calibration_external_rotational_axis.gh (Grasshopper 1.0.7)
# plug-ins: RobotComponentsABB, RobotComponentsEDEK

# ----
# World coordinate space
xy = XYPlane(Origin=Point(0, 0, 0))
pv = PlaneVisualizer(Plane=xy)

# ----
# Calibration tool
panel = Panel("-2.198211")  # disabled
panel_2 = Panel("-1.383457")  # disabled
panel_3 = Panel("286.8005")  # disabled
pt = ConstructPoint(XCoordinate=panel, YCoordinate=panel_2, ZCoordinate=panel_3)  # disabled
panel_4 = Panel("80")  # disabled
xy_2 = XYPlane(Origin=pt)  # disabled
cone = Cone(Base=PlaneXY(0, 0, 0), Radius=panel_4, Length=panel_3)  # -> Cone, Tip; disabled
panel_5 = Panel("calibration_tool")  # disabled
robtoool = RobotToolFromPlanes(Name=panel_5, Mesh=cone.Cone, AttachmentPlane=PlaneXY(0, 0, 0), ToolPlane=xy_2)  # -> RobotTool, RobotToolCode; disabled

# ----
# (2) Setup a real-time connection
button = Button()
gc = GetController(Update=button)
list = ValueList({"World": 1, "Base": 2, "Work Object": 4}, selected="World")
timer = Timer(TimerInterval=20, Target=gp)  # disabled
gp = GetPlane(RobotController=gc, CoordinateSystem=list)  # -> Plane, Name
item = ListItem(List=gp.Plane, Index="0", Wrap=True)
pt_2 = Point(item)
pv_2 = PlaneVisualizer(Plane=item)

# ----
# (3) Define the center and the x-axis of the axis plane
# Jog to three points on the edge of the plate. First point defines the x-axis
pt_3 = Point(Point(1608.965088, -2199.0271, 1030.062988))
pt_4 = Point(Point(1784.063232, -2199.978027, 856.0205688))
pt_5 = Point(Point(1454.96875, -2198.67334, 775.9737549))
fcircle = CircleFit(Points=[pt_3, pt_4, pt_5])  # -> Circle, Radius, Deviation

# ----
# (4) Define the orientation of the z-axis
# Jog to three points on the edge of end plate
# (or take one point that is the center)
pt_6 = Point(Point(1597.703003, 1817.375244, 897.0130005))
pt_7 = Point(Point(1597.709839, 1817.25769, 790.9990845))
pt_8 = Point(Point(1684.688354, 1816.773682, 846.9468994))
fcircle_2 = CircleFit(Points=[pt_7, pt_6, pt_8])  # -> Circle, Radius, Deviation

# ----
# X-axis
vec2pt = Vector2Pt(PointA=fcircle.Circle, PointB=pt_3, Unitize=False)  # -> Vector, Length

# ----
# Center (start)
pt_9 = Point(fcircle.Circle)

# ----
# Center end
pt_10 = Point(fcircle_2.Circle)

ln = Line(StartPoint=pt_9, EndPoint=pt_10)

# ----
# (5) Construct the axis plane
vec2pt_2 = Vector2Pt(PointA=pt_9, PointB=pt_10, Unitize=False)  # -> Vector, Length
pl = PlaneNormal(Origin=pt_9, ZAxis=vec2pt_2.Vector)
align = AlignPlane(Plane=pl, Direction=vec2pt.Vector)  # -> Plane, Angle
pln = Plane(align.Plane)

# ----
# (1) Robot cell setup
irbp_l300_l4000 = IRBPL300L4000(AxisPlane=pln)
xy_3 = XYPlane(Origin=Point(0, 0, 0))
irb4600 = IRB460040255Platform(PositionPlane=xy_3, ExternalAxis=irbp_l300_l4000)

# ----
# Work object
panel_6 = Panel("wobj1_ext")  # disabled
xy_4 = XYPlane(Origin=Point(0, 0, 0))  # disabled
workobj = WorkObject(Name=panel_6, Plane=xy_4, ExternalRotationalAxis=irbp_l300_l4000)  # disabled
pv_3 = PlaneVisualizer(Plane=workobj)  # disabled

# ----
# Axis plane data (for controller config)
ptoq = PlaneToQuaternion(Plane=pln, ReferencePlane=PlaneXY(0, 0, 0))  # -> CoordX, CoordY, CoordZ, QuaternionA, QuaternionB, QuaternionC, QuaternionD, String
panel_7 = Panel(ptoq.CoordX)
panel_8 = Panel(ptoq.CoordY)
panel_9 = Panel(ptoq.QuaternionA)
panel_10 = Panel(ptoq.QuaternionB)
panel_11 = Panel(ptoq.QuaternionC)
panel_12 = Panel(ptoq.QuaternionD)
panel_13 = Panel(ptoq.CoordZ)
