# Grasshopper definition Calibration_multi_robot_setup (proposal).gh (Grasshopper 1.0.7)
# plug-ins: RobotComponentsABB, RobotComponentsEDEK

# ----
# World coordinate space
xy = XYPlane(Origin=Point(0, 0, 0))
pv = PlaneVisualizer(Plane=xy)

# ----
# (1) Robot with track at fixed position
gudel = GUDELTrack()
irb4600 = IRB460040255(PositionPlane=PlaneXY(0, 0, 0), ExternalAxis=gudel)

# ----
# (2) Get three points in world coordinate space
# Jog with the robot tcp (that has the track) to these points and internalize them
gc = GetController(Update=True)  # disabled
list = ValueList({"World": 1, "Base": 2, "Work Object": 4}, selected="World")
timer = Timer(TimerInterval=20, Target=gp)  # disabled
gp = GetPlane(RobotController=gc, CoordinateSystem=list)  # -> Plane, Name
item = ListItem(List=gp.Plane, Index="0", Wrap=True)
pt = Point(item)

pt_2 = Point(Point(-2067.518427, 3909.777737, 0))
pt_3 = Point(Point(-952.8291599, 3909.777737, 0))
pt_4 = Point(Point(-2111.519319, 5112.468789, 0))
pl_3pt = Plane3Pt(PointA=pt_2, PointB=pt_3, PointC=pt_4)

# ----
# This can be your work object
panel = Panel("wobj1")
workobj = WorkObject(Name=panel, Plane=pl_3pt)

# ----
# (3) Get the  three points in robot coordinate space of the second robot
gc_2 = GetController(Update=True)  # disabled
list_2 = ValueList({"World": 1, "Base": 2, "Work Object": 4}, selected="Base")
timer_2 = Timer(TimerInterval=20, Target=gp_2)  # disabled
gp_2 = GetPlane(RobotController=gc_2, CoordinateSystem=list_2)  # -> Plane, Name
pt_5 = Point(gp_2.Plane)

pt_6 = Point(Point(934.0003181, 208.5668599, -227.2531491))
pt_7 = Point(Point(2031.739903, 401.8121105, -239.752729))
pt_8 = Point(Point(681.8262459, 1384.674876, -267.0025488))
pl_3pt_2 = Plane3Pt(PointA=pt_6, PointB=pt_7, PointC=pt_8)

# ----
# (4) Orient the XY Base frame to the real location in the world coordinate space
xy_2 = XYPlane(Origin=Point(0, 0, 0))
orient = Orient(Geometry=xy_2, Source=pl_3pt_2, Target=pl_3pt)  # -> Geometry, Transform
irb4600_2 = IRB460040255Platform(PositionPlane=orient.Geometry)

# ----
# Base frame data ROB2
ptoq = PlaneToQuaternion(Plane=orient.Geometry, ReferencePlane=PlaneXY(0, 0, 0))  # -> CoordX, CoordY, CoordZ, QuaternionA, QuaternionB, QuaternionC, QuaternionD, String
panel_2 = Panel(ptoq.CoordX)
panel_3 = Panel(ptoq.CoordY)
panel_4 = Panel(ptoq.CoordZ)
panel_5 = Panel(ptoq.QuaternionA)
panel_6 = Panel(ptoq.QuaternionB)
panel_7 = Panel(ptoq.QuaternionC)
panel_8 = Panel(ptoq.QuaternionD)
