# Grasshopper definition Brandthaus_Two_Robots_Multi_move.gh (Grasshopper 1.0.7)
# plug-ins: RobotComponentsABB, RobotComponentsEDEK

# ----
# Calibration tool
panel = Panel("-1.383457")
pt = ConstructPoint(XCoordinate="-2.198211", YCoordinate=panel, ZCoordinate="286.8005")
xy = XYPlane(Origin=pt)
cone = Cone(Base=PlaneXY(0, 0, 0), Radius="80", Length="286.8005")  # -> Cone, Tip
robtoool = RobotToolFromPlanes(Name="calibration_tool", Mesh=cone.Cone, AttachmentPlane=PlaneXY(0, 0, 0), ToolPlane=xy)

# ----
# Multi move custom code lines
panel_2 = Panel("""VAR syncident sync1;
VAR syncident sync2;
VAR syncident sync3;
PERS tasks all_tasks{2}:=[["T_ROB1"],["T_ROB2"]];
  """)
panel_3 = Panel("""WaitSyncTask sync1, all_tasks;
SyncMoveOn sync2, all_tasks;""")
list = ValueList({"Instruction": 0, "Declaration": 1}, selected="Declaration")
list_2 = ValueList({"Instruction": 0, "Declaration": 1}, selected="Instruction")
list_3 = ValueList({"Instruction": 0, "Declaration": 1}, selected="Instruction")
cl = CodeLine(Code=panel_3, Type=list_2)
cl_2 = CodeLine(Code="SyncMoveOff sync3;", Type=list_3)
cl_3 = CodeLine(Code=panel_2, Type=list)

# ----
# World coordinate space
xy_2 = XYPlane(Origin=Point(0, 0, 0))
pv = PlaneVisualizer(Plane=xy_2)

# ----
# Example tool
number_slider = Slider(300, range=0..300)
pt_2 = ConstructPoint(XCoordinate="0", YCoordinate="0", ZCoordinate=number_slider)
xy_3 = XYPlane(Origin=pt_2)
cone_2 = Cone(Base=PlaneXY(0, 0, 0), Radius="80", Length=number_slider)  # -> Cone, Tip
robtoool_2 = RobotToolFromPlanes(Name="example_tool", Mesh=cone_2.Cone, AttachmentPlane=PlaneXY(0, 0, 0), ToolPlane=xy_3)

# ----
# Get axis values and pose real time
button = Button()
gc = GetController(Update=button)
timer = Timer(TimerInterval=20, Target=ga)  # disabled
ga = GetAxisValues(RobotController=gc)  # -> RobotJointPosition, ExternalAxisValues
bang = ExplodeTree(Data=simplify(graft(ga.RobotJointPosition)))  # -> Branch0, Branch1
bang_2 = ExplodeTree(Data=simplify(ga.ExternalAxisValues))  # -> Branch0, Branch1

# ----
# Curve to follow
number_slider_2 = Slider(7, range=0..100)
crv = Curve(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)
divide = DivideCurve(Curve=crv, Count=number_slider_2, Kinks=False)  # -> Points, Tangents, Parameters
yz = YZPlane(Origin=divide.Points)

# ----
# (1) Robot with track at fixed position
gudel = GUDELTrack()
irb4600 = IRB460040255(PositionPlane=PlaneXY(0, 0, 0), RobotTool=robtoool_2, ExternalAxis=gudel)

# ----
# Base frame of track
ptoq = PlaneToQuaternion(Plane=gudel, ReferencePlane=PlaneXY(0, 0, 0))  # -> CoordX, CoordY, CoordZ, QuaternionA, QuaternionB, QuaternionC, QuaternionD
panel_4 = Panel(ptoq.CoordX)
panel_5 = Panel(ptoq.CoordY)
panel_6 = Panel(ptoq.CoordZ)
panel_7 = Panel(ptoq.QuaternionA)
panel_8 = Panel(ptoq.QuaternionB)
panel_9 = Panel(ptoq.QuaternionC)
panel_10 = Panel(ptoq.QuaternionD)

# ----
# ROB1
ri = Robot(irb4600)
fk = ForwardKinematics(Robot=ri, RobotJointPosition=bang.Branch0, ExternalJointPosition=bang_2.Branch1, Set_Hide_Mesh=False)  # -> PosedMeshes, EndPlane, ExternalAxisPlanes

# ----
# (2) Get three points in world coordinate space
# Jog with the robot tcp (that has the track) to these points and internalize them
gc_2 = GetController(Update=True)  # disabled
list_4 = ValueList({"World": 1, "Base": 2, "Work Object": 4}, selected="World")  # disabled
timer_2 = Timer(TimerInterval=20, Target=gp)  # disabled
gp = GetPlane(RobotController=gc_2, CoordinateSystem=list_4)  # -> Plane, Name; disabled
panel_11 = Panel("0")  # disabled
item = ListItem(List=gp.Plane, Index=panel_11, Wrap=True)  # disabled
pt_3 = Point(item)  # disabled

# ----
# Position of rotation axis
# in world coordinate space
# defined with the robot on the track
pln = Plane(Plane(origin=(-1949.336468, 2619.56963, 1077.016608), x=(-0.006665569063, -0.001175401014, 0.999977094), y=(0.9999498856, -0.007477703836, 0.006656598197)))

# ----
# ERA is in separate task
irbp_l300_l4000 = IRBPL300L4000(AxisPlane=pln)

pt_4 = Point(Point(-2067.518427, 3909.777737, 0))  # disabled
pt_5 = Point(Point(-952.8291599, 3909.777737, 0))  # disabled
pt_6 = Point(Point(-2111.519319, 5112.468789, 0))  # disabled
pl_3pt = Plane3Pt(PointA=pt_4, PointB=pt_5, PointC=pt_6)  # disabled

# ----
# Axis plane data (for controller config)
ptoq_2 = PlaneToQuaternion(Plane=pln, ReferencePlane=PlaneXY(0, 0, 0))  # -> CoordX, CoordY, CoordZ, QuaternionA, QuaternionB, QuaternionC, QuaternionD
panel_12 = Panel(ptoq_2.QuaternionB)
panel_13 = Panel(ptoq_2.QuaternionC)
panel_14 = Panel(ptoq_2.CoordX)
panel_15 = Panel(ptoq_2.CoordY)
panel_16 = Panel(ptoq_2.CoordZ)
panel_17 = Panel(ptoq_2.QuaternionA)
panel_18 = Panel(ptoq_2.QuaternionD)

# ----
# (3) Get the  three points in robot coordinate space of the second robot
gc_3 = GetController(Update=True)  # disabled
list_5 = ValueList({"World": 1, "Base": 2, "Work Object": 4}, selected="Base")  # disabled
timer_3 = Timer(TimerInterval=20, Target=gp_2)  # disabled
gp_2 = GetPlane(RobotController=gc_3, CoordinateSystem=list_5)  # -> Plane, Name; disabled
pt_7 = Point(gp_2.Plane)  # disabled

pt_8 = Point(Point(2031.739903, 401.8121105, -239.752729))  # disabled
pt_9 = Point(Point(681.8262459, 1384.674876, -267.0025488))  # disabled
pt_10 = Point(Point(934.0003181, 208.5668599, -227.2531491))  # disabled
pl_3pt_2 = Plane3Pt(PointA=pt_10, PointB=pt_8, PointC=pt_9)  # disabled

# ----
# Position of rotation axis
# in robot coordinate space
# defined with the mobile robot
pln_2 = Plane(Plane(origin=(1609.828051, -2199.237275, 855.8283903), x=(-0.00494615132, 0.002961798601, 0.9999833815), y=(0.999980542, -0.003786846151, 0.004957353338)))

# ----
# (4) Orient the XY Base frame to the real location in the world coordinate space
xy_4 = XYPlane(Origin=Point(0, 0, 0))
orient = Orient(Geometry=xy_4, Source=pln_2, Target=pln)  # -> Geometry, Transform
irb4600_2 = IRB460040255Platform(PositionPlane=orient.Geometry, RobotTool=robtoool_2)

# ----
# ROB2
ri_2 = Robot(irb4600_2)
fk_2 = ForwardKinematics(Robot=ri_2, RobotJointPosition=bang.Branch1, Set_Hide_Mesh=False)  # -> PosedMeshes, EndPlane, ExternalAxisPlanes

# ----
# Base frame data ROB2
ptoq_3 = PlaneToQuaternion(Plane=orient.Geometry, ReferencePlane=PlaneXY(0, 0, 0))  # -> CoordX, CoordY, CoordZ, QuaternionA, QuaternionB, QuaternionC, QuaternionD
panel_19 = Panel(ptoq_3.QuaternionB)
panel_20 = Panel(ptoq_3.QuaternionC)
panel_21 = Panel(ptoq_3.QuaternionD)
panel_22 = Panel(ptoq_3.CoordX)
panel_23 = Panel(ptoq_3.CoordY)
panel_24 = Panel(ptoq_3.CoordZ)
panel_25 = Panel(ptoq_3.QuaternionA)

list_6 = ValueList({"MoveAbsJ": 0, "MoveL": 1, "MoveJ": 2}, selected="MoveAbsJ")

rj = RobotJointPosition(
    RobotAxisValue1=Slider(0, range=-360..360),
    RobotAxisValue2=Slider(0, range=-360..360),
    RobotAxisValue3=Slider(0, range=-360..360),
    RobotAxisValue4=Slider(0, range=-360..360),
    RobotAxisValue5=Slider(-45, range=-360..360),
    RobotAxisValue6=Slider(0, range=-360..360))
jt = JointTarget(Name="abs_target_rob1", RobotJointPosition=rj, ExternalJointPosition=Slider(2500, range=0..10000))
M = Move(
    Target=jt,
    SpeedData=Slider(200, range=0..1000),
    MovementType=list_6,
    ZoneData=Slider(-1, range=-1..10),
    Override_Robot_Tool=False,
    Override_Work_Object=False,
    Set_Digital_Output=False)

list_7 = ValueList({"MoveAbsJ": 0, "MoveL": 1, "MoveJ": 2}, selected="MoveAbsJ")

rj_2 = RobotJointPosition(
    RobotAxisValue1=Slider(0, range=-360..360),
    RobotAxisValue2=Slider(0, range=-360..360),
    RobotAxisValue3=Slider(0, range=-360..360),
    RobotAxisValue4=Slider(0, range=-360..360),
    RobotAxisValue5=Slider(45, range=-360..360),
    RobotAxisValue6=Slider(0, range=-360..360))
jt_2 = JointTarget(Name="abs_target_rob2", RobotJointPosition=rj_2)
M_2 = Move(
    Target=jt_2,
    SpeedData=Slider(200, range=0..1000),
    MovementType=list_7,
    ZoneData=Slider(-1, range=-1..10),
    Override_Robot_Tool=False,
    Override_Work_Object=False,
    Set_Digital_Output=False)

# ----
# ROB1
ri_3 = Robot(irb4600)

# ----
# ROB2
ri_4 = Robot(irb4600_2)

flip_plane_x = FlipPlaneX(Plane=yz)
item_2 = ListItem(List=flip_plane_x, Index="0", Wrap=True)
item_3 = ListItem(List=flip_plane_x, Index="-1", Wrap=True)
neg = Negative(Value=Slider(300, range=0..1000))
pl_offset = PlaneOffset(BasePlane=item_2, Offset=neg)
pl_offset_2 = PlaneOffset(BasePlane=item_3, Offset=neg)
merge = Merge(Data1=flatten(pl_offset), Data2=flatten(flip_plane_x), Data3=flatten(pl_offset_2))
list_8 = ValueList({"MoveAbsJ": 0, "MoveL": 1, "MoveJ": 2}, selected="MoveJ")
list_9 = ValueList({"MoveAbsJ": 0, "MoveL": 1, "MoveJ": 2}, selected="MoveL")
merge_2 = Merge(Data1=list_8, Data2=list_9)
merge_3 = Merge(Data1=Slider(-1, range=-1..10), Data2=Slider(1, range=-1..10))

# ----
# Test program multi move
# Sync ID numbers
lng = ListLength(List=merge)
series = Series(Start="10", Step="10", Count=expr("x-1", lng))

expression = Expression(x="replace1", y=series, Expression="Format(\"{0}_{1}\", x, y)")
merge_4 = Merge(Data1=flatten("curve_targets_rob1"), Data2=flatten(expression))
rt = RobotTarget(
    Name=merge_4,
    Plane=merge,
    AxisConfiguration=0,
    ExternalJointPosition=Slider(3500, range=0..10000),
    Set_External_Joint_Position=True,
    Set_Reference_Plane=False)
M_3 = Move(
    Target=rt,
    SpeedData=Slider(200, range=0..1000),
    MovementType=merge_2,
    ZoneData=merge_3,
    Override_Robot_Tool=False,
    Override_Work_Object=False,
    Set_Digital_Output=False)
split = SplitList(List=M_3, Index="1")  # -> ListA, ListB

item_4 = ListItem(List=yz, Index="0", Wrap=True)
item_5 = ListItem(List=yz, Index="-1", Wrap=True)
neg_2 = Negative(Value=Slider(300, range=0..1000))
pl_offset_3 = PlaneOffset(BasePlane=item_4, Offset=neg_2)
pl_offset_4 = PlaneOffset(BasePlane=item_5, Offset=neg_2)
merge_5 = Merge(Data1=flatten(pl_offset_3), Data2=flatten(yz), Data3=flatten(pl_offset_4))
expression_2 = Expression(x="replace2", y=series, Expression="Format(\"{0}_{1}\", x, y)")
merge_6 = Merge(Data1=flatten("curve_targets_rob2"), Data2=flatten(expression_2))
rt_2 = RobotTarget(Name=merge_6, Plane=merge_5, AxisConfiguration=0, Set_External_Joint_Position=False, Set_Reference_Plane=False)
list_10 = ValueList({"MoveAbsJ": 0, "MoveL": 1, "MoveJ": 2}, selected="MoveJ")
list_11 = ValueList({"MoveAbsJ": 0, "MoveL": 1, "MoveJ": 2}, selected="MoveL")
merge_7 = Merge(Data1=list_10, Data2=list_11)
merge_8 = Merge(Data1=Slider(-1, range=-1..10), Data2=Slider(1, range=-1..10))

M_4 = Move(
    Target=rt_2,
    SpeedData=Slider(200, range=0..1000),
    MovementType=merge_7,
    ZoneData=merge_8,
    Override_Robot_Tool=False,
    Override_Work_Object=False,
    Set_Digital_Output=False)

split_2 = SplitList(List=M_4, Index="1")  # -> ListA, ListB

# ----
# ROB1
merge_9 = Merge(
    Data1=flatten(cl_3),
    Data2=flatten(M),
    Data3=flatten(split.ListA),
    Data4=flatten(cl),
    Data5=flatten(split.ListB),
    Data6=flatten(cl_2),
    Data7=flatten(M))
rg = RAPIDGenerator(Robot=ri_3, Action=merge_9, ProgramName="MainArjen", SystemName="arjen", Update=True)  # -> ProgramModule, SystemModule
panel_26 = Panel(rg.SystemModule)

# ----
# Replace dummy target names and assign ID
expression_3 = Expression(x="curve_targets_rob1", y=series, Expression="Format(\"{0}_{1}\\ID:={1},\", x, y)")
expression_4 = Expression(x="curve_targets_rob1", y=series, Expression="Format(\"{0}_{1}\", x, y)")
expression_5 = Expression(x="replace1", y=series, Expression="Format(\"{0}_{1},\", x, y)")
expression_6 = Expression(x="replace1", y=series, Expression="Format(\"{0}_{1}\", x, y)")
merge_10 = Merge(Data1=expression_5, Data2=expression_6)
merge_11 = Merge(Data1=expression_3, Data2=expression_4)
python = GhPythonScript(x=rg.ProgramModule, y=merge_10, z=merge_11)  # -> out, a; inputs y: list, z: list
# ---------- python: Python ----------
a = x

for i in range(0, len(y)):
    a = a.replace(y[i], z[i])
# ---------- end python ----------

panel_27 = Panel(python.a)

# ----
# ROB2
merge_12 = Merge(
    Data1=flatten(cl_3),
    Data2=flatten(M_2),
    Data3=flatten(split_2.ListA),
    Data4=flatten(cl),
    Data5=flatten(split_2.ListB),
    Data6=flatten(cl_2),
    Data7=flatten(M_2))
rg_2 = RAPIDGenerator(Robot=ri_4, Action=merge_12, ProgramName="MainArjen", SystemName="arjen", Update=True)  # -> ProgramModule, SystemModule
panel_28 = Panel(rg_2.SystemModule)

# ----
# Path generators
number_slider_3 = Slider(0, range=0..1)
pg = PathGenerator(
    Robot=ri_3,
    Action=merge_9,
    Interpolations=5,
    AnimationSlider=number_slider_3,
    Update=True,
    Set_Preview_Curve=True,
    Set_Preview_Mesh=True)  # -> Plane, ExternalAxisPlanes, RobotJointPosition, ExternalJointPosition, ToolPath
pg_2 = PathGenerator(
    Robot=ri_4,
    Action=merge_12,
    Interpolations=5,
    AnimationSlider=number_slider_3,
    Update=True,
    Set_Preview_Curve=True,
    Set_Preview_Mesh=True)  # -> Plane, ExternalAxisPlanes, RobotJointPosition, ExternalJointPosition, ToolPath

# ----
# Replace dummy target names and assign ID
expression_7 = Expression(x="curve_targets_rob2", y=series, Expression="Format(\"{0}_{1}\\ID:={1},\", x, y)")
expression_8 = Expression(x="curve_targets_rob2", y=series, Expression="Format(\"{0}_{1}\", x, y)")
expression_9 = Expression(x="replace2", y=series, Expression="Format(\"{0}_{1},\", x, y)")
expression_10 = Expression(x="replace2", y=series, Expression="Format(\"{0}_{1}\", x, y)")
merge_13 = Merge(Data1=expression_9, Data2=expression_10)
merge_14 = Merge(Data1=expression_7, Data2=expression_8)
python_2 = GhPythonScript(x=rg_2.ProgramModule, y=merge_13, z=merge_14)  # -> out, a; inputs y: list, z: list; same code as python

panel_29 = Panel(python_2.a)
