# Grasshopper definition ASL_Robot_with_track_and_positioner.gh (Grasshopper 1.0.7)
# plug-ins: RobotComponentsEDEK, RobotComponents.Gh

# ----
# Base Frame
panel = Panel("180.865841")
qtop = QuaternionToPlane(
    CoordX=panel,
    CoordY="1303.35484",
    CoordZ="348.908968",
    QuaternionA="0.495992",
    QuaternionB="0.503979",
    QuaternionC="-0.496175",
    QuaternionD="0.503793")

# ----
# Aditional link mesh
number_slider = Slider(1000, range=0..1000)
Z = UnitZ(Factor=1)
line = LineSDL(Start=Point(0, 0, 0), Direction=Z, Length=number_slider)
pipe = Pipe(Curve=line, Radius=Slider(25, range=0..100), Caps=0)

# ----
# Track + Positioner + Robot
igus_pos = IGUSPositioner(AxisPlane=qtop, LinkMesh=pipe)
igus = IGUSTrack()
merge = Merge(Data1=flatten(igus), Data2=flatten(igus_pos))
irb1200 = IRB1200509(PositionPlane=PlaneXY(0, 0, 0), ExternalAxis=merge)

# ----
# Forward kinematics playground
number_slider_2 = Slider(600, range=0..1150)
rj = RobotJointPosition(
    RobotAxisValue1=Slider(35, range=-360..360),
    RobotAxisValue2=Slider(44, range=-360..360),
    RobotAxisValue3=Slider(-9, range=-360..360),
    RobotAxisValue4=Slider(27, range=-360..360),
    RobotAxisValue5=Slider(22, range=-360..360),
    RobotAxisValue6=Slider(102, range=-360..360))
ej = ExternalJointPosition(ExternalAxisPositionA=number_slider_2, ExternalAxisPositionB=Slider(-44, range=-360..360))
fk = ForwardKinematics(Robot=irb1200, RobotJointPosition=rj, ExternalJointPosition=ej, Set_Hide_Mesh=False)  # -> PosedMeshes, EndPlane, ExternalAxisPlanes

# ----
# Code and path generation playground
number_slider_3 = Slider(0, range=0..9660)
pt = Point(Point(156.1363874, 783.4629187, 407.3261398))
xy = XYPlane(Origin=pt)
ej_2 = ExternalJointPosition(ExternalAxisPositionA=number_slider_3, ExternalAxisPositionB=Slider(0, range=0..100))
ej_3 = ExternalJointPosition(ExternalAxisPositionA=9000000000, ExternalAxisPositionB=Slider(100, range=0..100))
flip_plane_x = FlipPlaneX(Plane=xy)
rt = RobotTarget(
    Name="rob_target",
    Plane=flip_plane_x,
    AxisConfiguration=Slider(0, range=0..7),
    ExternalJointPosition=ej_3,
    Set_External_Joint_Position=True,
    Set_Reference_Plane=False)
jt = JointTarget(Name="home_target", ExternalJointPosition=ej_2)
list = ValueList({"MoveAbsJ": 0, "MoveL": 1, "MoveJ": 2}, selected="MoveAbsJ")
list_2 = ValueList({"MoveAbsJ": 0, "MoveL": 1, "MoveJ": 2}, selected="MoveJ")
M = Move(
    Target=jt,
    SpeedData=Slider(200, range=0..1000),
    MovementType=list,
    Override_Robot_Tool=False,
    Override_Work_Object=False,
    Set_Digital_Output=False)
M_2 = Move(
    Target=rt,
    SpeedData=Slider(200, range=0..1000),
    MovementType=list_2,
    Override_Robot_Tool=False,
    Override_Work_Object=False,
    Set_Digital_Output=False)
merge_2 = Merge(Data1=flatten(M), Data2=flatten(M_2), Data3=flatten(M))
pg = PathGenerator(
    Robot=irb1200,
    Action=merge_2,
    Interpolations=5,
    AnimationSlider=Slider(0, range=0..1),
    Update=True,
    Set_Preview_Curve=True,
    Set_Preview_Mesh=True)  # -> Plane, ExternalAxisPlanes, RobotJointPosition, ExternalJointPosition, ToolPath
rg = RAPIDGenerator(Robot=irb1200, Action=merge_2, ProgramName="MainModule", SystemName="BASE", Update=True)  # -> ProgramModule, SystemModule
panel_2 = Panel(rg.ProgramModule)
panel_3 = Panel(rg.SystemModule)

# ----
# Controller utility playground
button = Button()
gc = GetController(Update=button)
list_3 = ValueList({"World": 1, "Base": 2, "Work Object": 4}, selected="World")
ga = GetAxisValues(RobotController=gc)  # -> RobotJointPosition, ExternalAxisValues
gp = GetPlane(RobotController=gc, CoordinateSystem=list_3)  # -> Plane, Name
remote_connection = RemoteConnection(
    RobotController=gc,
    Connect=Toggle(True),
    Upload=Button(),
    Run=Button(),
    Stop=Button(),
    ProgramModule=rg.ProgramModule,
    SystemModule=rg.SystemModule)
bang = ExplodeTree(Data=simplify(ga.ExternalAxisValues))  # -> Branch0, Branch1
pv = PlaneVisualizer(Plane=gp.Plane)
panel_4 = Panel(remote_connection)
ej_4 = ExternalJointPosition(ExternalAxisPositionA=bang.Branch0, ExternalAxisPositionB=bang.Branch1)
fk_2 = ForwardKinematics(Robot=irb1200, RobotJointPosition=ga.RobotJointPosition, ExternalJointPosition=ej_4, Set_Hide_Mesh=False)  # -> PosedMeshes, EndPlane, ExternalAxisPlanes
pv_2 = PlaneVisualizer(Plane=fk_2.EndPlane)
