# Grasshopper definition Brandthaus_Robot_with_track.gh (Grasshopper 1.0.7)
# plug-ins: RobotComponentsABB, RobotComponentsEDEK

# ----
# The preset: Track + Robot
gudel = GUDELTrack()
irb4600 = IRB460040255(PositionPlane=PlaneXY(0, 0, 0), ExternalAxis=gudel)

# ----
# Forward kinematics playground
number_slider = Slider(35, range=-360..360)
rj = RobotJointPosition(
    RobotAxisValue1=number_slider,
    RobotAxisValue2=Slider(75, range=-360..360),
    RobotAxisValue3=Slider(-137, range=-360..360),
    RobotAxisValue4=Slider(27, range=-360..360),
    RobotAxisValue5=Slider(22, range=-360..360),
    RobotAxisValue6=Slider(102, range=-360..360))
fk = ForwardKinematics(Robot=irb4600, RobotJointPosition=rj, ExternalJointPosition=Slider(3778, range=-5..9620), Set_Hide_Mesh=False)  # -> PosedMeshes, EndPlane, ExternalAxisPlanes

# ----
# Code and path generation playground
pt = Point(Point(-414.3207008, 4471.25787, 521.1986835))
xy = XYPlane(Origin=pt)
flip_plane_x = FlipPlaneX(Plane=xy)
jt = JointTarget(Name="home_target", ExternalJointPosition=Slider(0, range=0..100))
rt = RobotTarget(
    Name="rob_target",
    Plane=flip_plane_x,
    AxisConfiguration=Slider(0, range=0..7),
    Set_External_Joint_Position=False,
    Set_Reference_Plane=False)
list = ValueList({"MoveAbsJ": 0, "MoveL": 1, "MoveJ": 2}, selected="MoveAbsJ")
list_2 = ValueList({"MoveAbsJ": 0, "MoveL": 1, "MoveJ": 2}, selected="MoveAbsJ")
M = Move(
    Target=jt,
    SpeedData=Slider(200, range=0..1000),
    MovementType=list,
    Override_Robot_Tool=False,
    Override_Work_Object=False,
    Set_Digital_Output=False)

M_2 = Move(
    Target=rt,
    SpeedData=Slider(200, range=0..1000),
    MovementType=list_2,
    Override_Robot_Tool=False,
    Override_Work_Object=False,
    Set_Digital_Output=False)

merge = Merge(Data1=flatten(M), Data2=flatten(M_2), Data3=flatten(M))
pg = PathGenerator(
    Robot=irb4600,
    Action=merge,
    Interpolations=5,
    AnimationSlider=Slider(0, range=0..1),
    Update=True,
    Set_Preview_Curve=True,
    Set_Preview_Mesh=True)  # -> Plane, ExternalAxisPlanes, RobotJointPosition, ExternalJointPosition, ToolPath
rg = RAPIDGenerator(Robot=irb4600, Action=merge, ProgramName="MainModule", SystemName="BASE", Update=True)  # -> ProgramModule, SystemModule
panel = Panel(rg.ProgramModule)
panel_2 = Panel(rg.SystemModule)

# ----
# Controller utility playground
button = Button()
gc = GetController(Update=button)
list_3 = ValueList({"World": 1, "Base": 2, "Work Object": 4}, selected="World")
timer = Timer(TimerInterval=20, Target=[gp, ga])  # disabled
ga = GetAxisValues(RobotController=gc)  # -> RobotJointPosition, ExternalAxisValues
gp = GetPlane(RobotController=gc, CoordinateSystem=list_3)  # -> Plane, Name
remote_connection = RemoteConnection(
    RobotController=gc,
    Connect=Toggle(True),
    Upload=Button(),
    Run=Button(),
    Stop=Button(),
    ProgramModule=rg.ProgramModule,
    SystemModule=rg.SystemModule)
pv = PlaneVisualizer(Plane=gp.Plane)
panel_3 = Panel(remote_connection)
fk_2 = ForwardKinematics(
    Robot=irb4600,
    RobotJointPosition=ga.RobotJointPosition,
    ExternalJointPosition=ga.ExternalAxisValues,
    Set_Hide_Mesh=False)  # -> PosedMeshes, EndPlane, ExternalAxisPlanes
pv_2 = PlaneVisualizer(Plane=fk_2.EndPlane)
