# Grasshopper definition Brandthaus_Robot_with_track_and_positioner.gh (Grasshopper 1.0.7)
# plug-ins: RobotComponentsEDEK, RobotComponents.Gh

# ----
# Base Frame
panel = Panel("-1800")
qtop = QuaternionToPlane(
    CoordX=panel,
    CoordY="2000",
    CoordZ="855",
    QuaternionA="-0.50",
    QuaternionB="0.50",
    QuaternionC="0.50",
    QuaternionD="0.50")

# ----
# Aditional link mesh
number_slider = Slider(4000, range=0..4000)
Z = UnitZ(Factor=1)
line = LineSDL(Start=Point(0, 0, 0), Direction=Z, Length=number_slider)
pipe = Pipe(Curve=line, Radius=Slider(25, range=0..100), Caps=0)

# ----
# The preset: Track +  Positioner + Robot
irbp_l300_l4000 = IRBPL300L4000(AxisPlane=qtop, LinkMesh=pipe)
gudel = GUDELTrack()
merge = Merge(Data1=flatten(gudel), Data2=flatten(irbp_l300_l4000))
irb4600 = IRB460040255(PositionPlane=PlaneXY(0, 0, 0), ExternalAxis=merge)

# ----
# Forward kinematics playground
number_slider_2 = Slider(35, range=-360..360)
rj = RobotJointPosition(
    RobotAxisValue1=number_slider_2,
    RobotAxisValue2=Slider(75, range=-360..360),
    RobotAxisValue3=Slider(-137, range=-360..360),
    RobotAxisValue4=Slider(27, range=-360..360),
    RobotAxisValue5=Slider(22, range=-360..360),
    RobotAxisValue6=Slider(102, range=-360..360))
ej = ExternalJointPosition(ExternalAxisPositionA=Slider(3779, range=-5..9620), ExternalAxisPositionB=Slider(-111, range=-360..360))
fk = ForwardKinematics(Robot=irb4600, RobotJointPosition=rj, ExternalJointPosition=ej, Set_Hide_Mesh=False)  # -> PosedMeshes, EndPlane, ExternalAxisPlanes

# ----
# Code and path generation playground
number_slider_3 = Slider(0, range=0..9660)
pt = Point(Point(-1124.674129, 4088.607358, 521.1986835))
xy = XYPlane(Origin=pt)
ej_2 = ExternalJointPosition(ExternalAxisPositionA=number_slider_3, ExternalAxisPositionB=Slider(0, range=0..100))
ej_3 = ExternalJointPosition(ExternalAxisPositionA=9000000000, ExternalAxisPositionB=Slider(100, range=0..100))
flip_plane_x = FlipPlaneX(Plane=xy)
rt = RobotTarget(
    Name="rob_target",
    Plane=flip_plane_x,
    AxisConfiguration=Slider(0, range=0..7),
    ExternalJointPosition=ej_3,
    Set_External_Joint_Position=True,
    Set_Reference_Plane=False)
jt = JointTarget(Name="home_target", ExternalJointPosition=ej_2)
list = ValueList({"MoveAbsJ": 0, "MoveL": 1, "MoveJ": 2}, selected="MoveAbsJ")
list_2 = ValueList({"MoveAbsJ": 0, "MoveL": 1, "MoveJ": 2}, selected="MoveJ")
M = Move(
    Target=rt,
    SpeedData=Slider(200, range=0..1000),
    MovementType=list_2,
    Override_Robot_Tool=False,
    Override_Work_Object=False,
    Set_Digital_Output=False)

M_2 = Move(
    Target=jt,
    SpeedData=Slider(200, range=0..1000),
    MovementType=list,
    Override_Robot_Tool=False,
    Override_Work_Object=False,
    Set_Digital_Output=False)

merge_2 = Merge(Data1=flatten(M_2), Data2=flatten(M), Data3=flatten(M_2))
pg = PathGenerator(
    Robot=irb4600,
    Action=merge_2,
    Interpolations=5,
    AnimationSlider=Slider(1, range=0..1),
    Update=True,
    Set_Preview_Curve=True,
    Set_Preview_Mesh=True)  # -> Plane, ExternalAxisPlanes, RobotJointPosition, ExternalJointPosition, ToolPath
rg = RAPIDGenerator(Robot=irb4600, Action=merge_2, ProgramName="MainModule", SystemName="BASE", Update=True)  # -> ProgramModule, SystemModule
panel_2 = Panel(rg.ProgramModule)
panel_3 = Panel(rg.SystemModule)

# ----
# Controller utility playground
button = Button()
gc = GetController(Update=button)
list_3 = ValueList({"World": 1, "Base": 2, "Work Object": 4}, selected="World")
timer = Timer(TimerInterval=20, Target=[gp, ga])  # disabled
gp = GetPlane(RobotController=gc, CoordinateSystem=list_3)  # -> Plane, Name
ga = GetAxisValues(RobotController=gc)  # -> RobotJointPosition, ExternalAxisValues
remote_connection = RemoteConnection(
    RobotController=gc,
    Connect=Toggle(True),
    Upload=Button(),
    Run=Button(),
    Stop=Button(),
    ProgramModule=rg.ProgramModule,
    SystemModule=rg.SystemModule)
bang = ExplodeTree(Data=ga.ExternalAxisValues)  # -> Branch0, Branch1
pv = PlaneVisualizer(Plane=gp.Plane)
panel_4 = Panel(remote_connection)
ej_4 = ExternalJointPosition(ExternalAxisPositionA=bang.Branch0, ExternalAxisPositionB=bang.Branch1)
fk_2 = ForwardKinematics(Robot=irb4600, RobotJointPosition=ga.RobotJointPosition, ExternalJointPosition=ej_4, Set_Hide_Mesh=False)  # -> PosedMeshes, EndPlane, ExternalAxisPlanes
pv_2 = PlaneVisualizer(Plane=fk_2.EndPlane)
