# Grasshopper definition Construct_Quarternion_to_Plane.gh (Grasshopper 1.0.7)
# plug-ins: RobotComponentsABB, RobotComponentsEDEK

qtop = QuaternionToPlane(CoordX="0", CoordY="0", CoordZ="250", QuaternionA="1", QuaternionB="0", QuaternionC="0", QuaternionD="0")
# Robot Info
irb4600 = IRB460040255Platform(PositionPlane=qtop)
