# Grasshopper definition Deconstruct_Plane_to_Quaternion.gh (Grasshopper 1.0.7)
# plug-ins: RobotComponentsABB, RobotComponentsEDEK

# External Linear axis
igus = IGUSTrack()
# Robot Info
irb1200 = IRB1200509(PositionPlane=PlaneXY(0, 0, 0), ExternalAxis=igus)
# Robot Info
irb4600 = IRB460040255Platform()
# Deconstruct ELA
deconela = DeconstructExternalLinearAxis(ExternalLinearAxis=igus)  # -> Name, AttachmentPlane, Axis, AxisLimits, BaseMesh, LinkMesh
# Deconstruct RI
derobinfo = DeconstructRobotInfo(RobotInfo=irb4600)  # -> Name, Meshes, AxisPlanes, AxisLimits, PositionPlane, MountingFrame, ToolPlane, RobotTool, ExternalAxis
ptoq = PlaneToQuaternion(Plane=deconela.AttachmentPlane, ReferencePlane=PlaneXY(0, 0, 0))  # -> CoordX, CoordY, CoordZ, QuaternionA, QuaternionB, QuaternionC, QuaternionD, String
ptoq_2 = PlaneToQuaternion(Plane=derobinfo.PositionPlane, ReferencePlane=PlaneXY(0, 0, 0))  # -> CoordX, CoordY, CoordZ, QuaternionA, QuaternionB, QuaternionC, QuaternionD, String
panel = Panel(ptoq.CoordX)
panel_2 = Panel(ptoq.CoordY)
panel_3 = Panel(ptoq.CoordZ)
panel_4 = Panel(ptoq.QuaternionA)
panel_5 = Panel(ptoq.QuaternionB)
panel_6 = Panel(ptoq.QuaternionC)
panel_7 = Panel(ptoq.QuaternionD)
panel_8 = Panel(ptoq_2.CoordX)
panel_9 = Panel(ptoq_2.CoordY)
panel_10 = Panel(ptoq_2.CoordZ)
panel_11 = Panel(ptoq_2.QuaternionA)
panel_12 = Panel(ptoq_2.QuaternionB)
panel_13 = Panel(ptoq_2.QuaternionC)
panel_14 = Panel(ptoq_2.QuaternionD)
