# Grasshopper definition GUDEL_Track.gh (Grasshopper 1.0.7)
# plug-ins: RobotComponentsABB, RobotComponentsEDEK

# ----
# Name
# Robot mesh
panel = Panel("GUDEL-track")

# ----
# Mesh settings
number_slider = Slider(0, range=0..500)
custom_mesh_settings = SettingsCustom(
    StitchSeams=True,
    SimplePlanes=Toggle(True),
    Refine=Toggle(True),
    MinCount=Slider(0, range=0..50),
    MaxCount=Slider(0, range=0..50),
    AspectRatio=number_slider,
    MaxDistance=Slider(0, range=0..10),
    MaxAngle=Slider(0, range=0..360),
    MinEdge=Slider(0, range=0..20),
    MaxEdge=Slider(0, range=0..500))

pipeline = GeometryPipeline(
    GroupByLayer=False,
    GroupByType=False,
    IncludeHidden=True,
    IncludeLocked=True,
    LayerFilter="1",
    NameFilter="*",
    SublayerFiltering=True,
    TypeFilter=1073741848)
pipeline_2 = GeometryPipeline(
    GroupByLayer=False,
    GroupByType=False,
    IncludeHidden=True,
    IncludeLocked=True,
    LayerFilter="0",
    NameFilter="*",
    SublayerFiltering=True,
    TypeFilter=1073741848)
brep = Brep(pipeline_2)
brep_2 = Brep(pipeline)
mesh = MeshBrep(Brep=brep, Settings=custom_mesh_settings)  # -> flatten(Mesh)
mesh_2 = MeshBrep(Brep=brep_2, Settings=custom_mesh_settings)  # -> flatten(Mesh)
mjoin = MeshJoin(Meshes=mesh)
mjoin_2 = MeshJoin(Meshes=mesh_2)
merge = Merge(Data1=mjoin, Data2=mjoin_2)  # -> flatten(Result)

# ----
# Mesh reduce
number_slider_2 = Slider(20000, range=0..20000)
merge_2 = Merge(Data1=Slider(80000, range=0..80000), Data2=number_slider_2)
python = GhPythonScript(mesh=merge, count=merge_2)  # -> out, mesh; inputs mesh: list of Mesh, count: list of Int32
# ---------- python: Python ----------
import Rhino.Geometry as rg

for i in range(len(mesh)):
    mesh[i].Reduce(count[i], True, 10, False)
# ---------- end python ----------

# ----
# Count mesh faces
demesh = DeconstructMesh(Mesh=merge)  # -> Vertices, flatten(Faces), Colours, Normals
lng = ListLength(List=demesh.Faces)
panel_2 = Panel(lng)

# ----
# Binary formatter
# Convert mesh to string
# Convert string to mesh
rep = ReplaceText(Text=panel, Find="/", Replace="-", RecursiveReplace=False)
rep_2 = ReplaceText(Text=rep, Find=".", Replace="_", RecursiveReplace=False)
rep_3 = ReplaceText(Text=rep_2, Find="-", Replace="_", RecursiveReplace=False)
panel_3 = Panel(rep_3)
python_2 = GhPythonScript(meshes=python.mesh, name=panel_3, write=Button())  # -> out, text; inputs meshes: list of Mesh, write: Boolean
# ---------- python_2: Python ----------
import System
import os

import clr
clr.AddReference("RobotComponents.dll")
import RobotComponents.Utils.HelperMethods as helper

text = []
path = os.path.dirname(ghenv.Component.Attributes.Owner.OnPingDocument().FilePath)

for i in range(0, len(meshes)):
    text.append(System.Convert.ToBase64String(helper.ObjectToByteArray(meshes[i])))
    if write == True:
        filename = os.path.join(path, "{}_link_{}.txt".format(name, i))
        file = open(filename,'w+') 
        file.write(text[i]) 
        file.close()
# ---------- end python_2 ----------
text = Text(python_2.text)  # disabled
number_slider_3 = Slider(0, range=0..6)  # disabled
item = ListItem(List=text, Index=number_slider_3, Wrap=True)  # disabled
python_3 = GhPythonScript(text=item)  # -> out, mesh; disabled
# ---------- python_3: Python ----------
import System
import Grasshopper
import os

import clr
clr.AddReference("RobotComponents.dll")
import RobotComponents.Utils.HelperMethods as helper

mesh = helper.ByteArrayToObject(System.Convert.FromBase64String(text))
# ---------- end python_3 ----------
mesh_3 = Mesh(python_3.mesh)  # disabled

# ----
# Axis limits
panel_4 = Panel("9620")
dom = ConstructDomain(DomainStart="-5", DomainEnd=panel_4)

# ----
# Robot end-effector: for debugging purposes
number_slider_4 = Slider(50, range=0..200)
number_slider_5 = Slider(150, range=0..200)
xy = XYPlane(Origin=Point(0, 0, 0))
cone = Cone(Base=xy, Radius=number_slider_4, Length=number_slider_5)  # -> Cone, Tip
Z = UnitZ(Factor=number_slider_5)
mesh_4 = Mesh(cone.Cone)
move = Move(Geometry=xy, Motion=Z)  # -> Geometry, Transform
robtoool = RobotToolFromPlanes(Name="debug_tool", Mesh=mesh_4, AttachmentPlane=xy, ToolPlane=move.Geometry)  # -> RobotTool, RobotToolCode

# ----
# Mesh
panel_5 = Panel("1")
split = SplitList(List=python.mesh, Index=panel_5)  # -> ListA, ListB

# ----
# Predefined external linear axis
gudel = GUDELTrack()

X = UnitX(Factor=1)

# ----
# Robot info
irb4600 = IRB460040255(PositionPlane=PlaneXY(0, 0, 0), RobotTool=robtoool.RobotTool, ExternalAxis=gudel)

# ----
# Forward kinematics
number_slider_6 = Slider(3783, range=-5..9620)
merge_3 = Merge(
    Data1=Slider(-100, range=-180..180),
    Data2=Slider(43, range=-180..180),
    Data3=Slider(-47, range=-180..180),
    Data4=Slider(65, range=-180..180),
    Data5=Slider(-53, range=-180..180),
    Data6=Slider(66, range=-180..180))  # -> flatten(Result)
fk = ForwardKinematics(RobotInfo=irb4600, InternalAxisValues=merge_3, ExternalAxisValues=number_slider_6, Set_Hide_Mesh=False)  # -> PosedMeshes, EndPlane, ExternalAxisPlanes
pv = PlaneVisualizer(Plane=fk.EndPlane)

# ----
# Custom external linear axis
# Axis plane
panel_6 = Panel("0")
pt = ConstructPoint(XCoordinate=panel_6, YCoordinate="0", ZCoordinate="2565")
xy_2 = XYPlane(Origin=Point(0, 0, 0))
external_linear_axis = ExternalLinearAxis(Name="M8DM1", AttachmentPlane=xy_2, Axis=X, AxisLimits=dom, BaseMesh=split.ListA, LinkMesh=split.ListB)

Y = UnitY(Factor=1)
X_2 = UnitX(Factor=1)
pl = ConstructPlane(Origin=pt, XAxis=Y, YAxis=X_2)

orient = Orient(Geometry=external_linear_axis, Source=xy_2, Target=pl)  # -> Geometry, Transform
