# Grasshopper definition IGUS_Positioner.gh (Grasshopper 1.0.7)
# plug-ins: RobotComponentsABB, RobotComponentsEDEK

# ----
# Name
# Robot mesh
panel = Panel("IGUS_positioner")

# ----
# Mesh settings
number_slider = Slider(0, range=0..500)
custom_mesh_settings = SettingsCustom(
    StitchSeams=True,
    SimplePlanes=Toggle(True),
    Refine=Toggle(True),
    MinCount=Slider(0, range=0..50),
    MaxCount=Slider(0, range=0..50),
    AspectRatio=number_slider,
    MaxDistance=Slider(0, range=0..10),
    MaxAngle=Slider(0, range=0..360),
    MinEdge=Slider(0, range=0..20),
    MaxEdge=Slider(0, range=0..500))

pipeline = GeometryPipeline(
    GroupByLayer=False,
    GroupByType=False,
    IncludeHidden=True,
    IncludeLocked=True,
    LayerFilter="1",
    NameFilter="*",
    SublayerFiltering=True,
    TypeFilter=1073741848)
pipeline_2 = GeometryPipeline(
    GroupByLayer=False,
    GroupByType=False,
    IncludeHidden=True,
    IncludeLocked=True,
    LayerFilter="0",
    NameFilter="*",
    SublayerFiltering=True,
    TypeFilter=1073741848)
brep = Brep(pipeline_2)
brep_2 = Brep(pipeline)
mesh = MeshBrep(Brep=brep, Settings=custom_mesh_settings)  # -> flatten(Mesh)
mesh_2 = MeshBrep(Brep=brep_2, Settings=custom_mesh_settings)  # -> flatten(Mesh)
mjoin = MeshJoin(Meshes=mesh)
mjoin_2 = MeshJoin(Meshes=mesh_2)
merge = Merge(Data1=mjoin, Data2=mjoin_2)  # -> flatten(Result)

# ----
# Mesh reduce
number_slider_2 = Slider(5000, range=0..10000)
merge_2 = Merge(Data1=Slider(10000, range=0..30000), Data2=number_slider_2)
python = GhPythonScript(mesh=merge, count=merge_2)  # -> out, mesh; inputs mesh: list of Mesh, count: list of Int32
# ---------- python: Python ----------
import Rhino.Geometry as rg

for i in range(len(mesh)):
    mesh[i].Reduce(count[i], True, 10, False)
# ---------- end python ----------

# ----
# Count mesh faces
demesh = DeconstructMesh(Mesh=python.mesh)  # -> Vertices, flatten(Faces), Colours, Normals
lng = ListLength(List=demesh.Faces)
panel_2 = Panel(lng)

# ----
# Binary formatter
# Convert mesh to string
# Convert string to mesh
rep = ReplaceText(Text=panel, Find="/", Replace="-", RecursiveReplace=False)
rep_2 = ReplaceText(Text=rep, Find=".", Replace="_", RecursiveReplace=False)
rep_3 = ReplaceText(Text=rep_2, Find="-", Replace="_", RecursiveReplace=False)
panel_3 = Panel(rep_3)
python_2 = GhPythonScript(meshes=python.mesh, name=panel_3, write=Button())  # -> out, text; inputs meshes: list of Mesh, write: Boolean
# ---------- python_2: Python ----------
import System
import os

import clr
clr.AddReference("RobotComponents.dll")
import RobotComponents.Utils.HelperMethods as helper

text = []
path = os.path.dirname(ghenv.Component.Attributes.Owner.OnPingDocument().FilePath)

for i in range(0, len(meshes)):
    text.append(System.Convert.ToBase64String(helper.ObjectToByteArray(meshes[i])))
    if write == True:
        filename = os.path.join(path, "{}_link_{}.txt".format(name, i))
        file = open(filename,'w+') 
        file.write(text[i]) 
        file.close()
# ---------- end python_2 ----------
text = Text(python_2.text)  # disabled
number_slider_3 = Slider(0, range=0..6)  # disabled
item = ListItem(List=text, Index=number_slider_3, Wrap=True)  # disabled
python_3 = GhPythonScript(text=item)  # -> out, mesh; disabled
# ---------- python_3: Python ----------
import System
import Grasshopper
import os

import clr
clr.AddReference("RobotComponents.dll")
import RobotComponents.Utils.HelperMethods as helper

mesh = helper.ByteArrayToObject(System.Convert.FromBase64String(text))
# ---------- end python_3 ----------
mesh_3 = Mesh(python_3.mesh)  # disabled

# ----
# Robot end-effector: for debugging purposes
number_slider_4 = Slider(25, range=0..200)
number_slider_5 = Slider(100, range=0..200)
xy = XYPlane(Origin=Point(0, 0, 0))
cone = Cone(Base=xy, Radius=number_slider_4, Length=number_slider_5)  # -> Cone, Tip
Z = UnitZ(Factor=number_slider_5)
mesh_4 = Mesh(cone.Cone)
move = Move(Geometry=xy, Motion=Z)  # -> Geometry, Transform
robtoool = RobotToolFromPlanes(Name="debug_tool", Mesh=mesh_4, AttachmentPlane=xy, ToolPlane=move.Geometry)  # -> RobotTool, RobotToolCode

# ----
# Axis limits
panel_4 = Panel("1.25664E+09")
dom = ConstructDomain(DomainStart=expr("-x", panel_4), DomainEnd=panel_4)

# ----
# Mesh
panel_5 = Panel("1")
split = SplitList(List=python.mesh, Index=panel_5)  # -> ListA, ListB

Z_2 = UnitZ(Factor=1)

vec = VectorXYZ(XComponent=Slider(0, range=-1..1), YComponent=Slider(-1, range=-1..1), ZComponent=Slider(0, range=-1..1))  # -> Vector, Length
pt = ConstructPoint(XCoordinate="500", YCoordinate="300", ZCoordinate="200")
pl = PlaneNormal(Origin=pt, ZAxis=vec.Vector)
align = AlignPlane(Plane=pl, Direction=Z_2)  # -> Plane, Angle

# ----
# Predefined external rotational axis
igus_pos = IGUSPositioner(AxisPlane=align.Plane)

# ----
# Custom external rotational axis
# Axis plane
panel_6 = Panel("M8DM1")
xy_2 = XYPlane(Origin=Point(0, 0, 0))
external_rotational_axis = ExternalRotationalAxis(Name=panel_6, AxisPlane=xy_2, AxisLimits=dom, BaseMesh=split.ListA, LinkMesh=split.ListB)
orient = Orient(Geometry=external_rotational_axis, Source=xy_2, Target=align.Plane)  # -> Geometry, Transform

# ----
# Robot info
irb1200 = IRB1200509(PositionPlane=PlaneXY(0, 0, 0), RobotTool=robtoool.RobotTool, ExternalAxis=igus_pos)

# ----
# Forward kinematics
number_slider_6 = Slider(-13, range=-180..180)
merge_3 = Merge(
    Data1=number_slider_6,
    Data2=Slider(43, range=-180..180),
    Data3=Slider(-22, range=-180..180),
    Data4=Slider(62, range=-180..180),
    Data5=Slider(57, range=-180..180),
    Data6=Slider(-60, range=-180..180))  # -> flatten(Result)
fk = ForwardKinematics(RobotInfo=irb1200, InternalAxisValues=merge_3, ExternalAxisValues=Slider(-62, range=-360..360), Set_Hide_Mesh=False)  # -> PosedMeshes, EndPlane, ExternalAxisPlanes
pv = PlaneVisualizer(Plane=fk.EndPlane)
